# Grasshopper definition Yamagata.gh (Grasshopper 1.0.7)
# plug-ins: karambaGH

# ---- group: 解析モデルの作成
pt = ConstructPoint(XCoordinate=Slider(5, range=0..10), YCoordinate=0, ZCoordinate=Slider(0, range=0..10))
pt_2 = ConstructPoint(XCoordinate=0, YCoordinate=0, ZCoordinate=0)
pt_3 = ConstructPoint(XCoordinate=Slider(10, range=0..10), YCoordinate=0, ZCoordinate=0)
ln = Line(StartPoint=pt_2, EndPoint=pt)
ln_2 = Line(StartPoint=pt, EndPoint=pt_3)

# ---- group: 断面の設定
number_slider = Slider(20, range=0..100)
number_slider_2 = Slider(1.3, range=0..10)
cross_section = CrossSectionKaramba3D(
    FamilyNameOfCrossSection="DefaultCroSec",
    Material=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,
    Height_cm=Slider(40, range=0..100),
    UpperFlangeWidth_cm=number_slider,
    LowerFlangeWidth_cm=number_slider,
    UpperFlangeThickness_cm=number_slider_2,
    LowerFlangeThickness_cm=number_slider_2,
    WebThickness_cm=Slider(0.8, range=0..1),
    FilletRadius_cm=0,
    mode="I")

# ---- group: 荷重の設定
Z = UnitZ(Factor=1)
neg = Negative(Value=Z)
loads = LoadsKaramba3D(Vector=neg, LCase=0, mode="Gravity")

# ---- group: 境界条件の設定
supp = SupportKaramba3D(PosInd=pt_2, menu=[buttons(on, on, on, on, off, off)])
supp_2 = SupportKaramba3D(PosInd=pt_3, menu=[buttons(off, on, on, on, off, off)])

# ---- group: Karamba用に梁要素に変換
linetobeam = LineToBeamKaramba3D(Line=[ln, ln_2], CrossSection=cross_section, New=True, Remove=True, LimitDistance_m=0.005)  # -> Element, Points, Info

# ---- group: モデルデータのアッセンブリ
assemble = AssembleModelKaramba3D(Elem=linetobeam.Element, Support=[supp, supp_2], Load=loads, LimitDistance_m=0.005)  # -> Model, Info, Mass_kg, CenterOfGravity

# ---- group: 解析実行箇所
analyze = AnalyzeKaramba3D(Model=assemble.Model)  # -> CalculatedModel, MaximumDisplacement_cm, ResultingForceOfGravity_kN, ElasticEnergy_kNm

# ---- group: 結果の可視化
beamview = BeamViewKaramba3D(Model=analyze.CalculatedModel)  # -> Model, MeshesOfRenderedBeams, DeformedBeamAxes, LegendColors, LegendTags
legend = Legend(Colour=beamview.LegendColors, Tags=beamview.LegendTags, LegendType=101)
